# Grasshopper definition evaluate.gh (Grasshopper 1.0.7)
# plug-ins: Vox, Portal, Heteroptera

trigger = Trigger(Interval=-1, TimerInterval=5, Target=[file, file_2])  # disabled
write = Button()
path = FilePath("F:\lab\3d-autoencoder\data\test\inference_0")
path_2 = FilePath("F:\lab\3d-autoencoder\output\inference\inference_output_thresholded.json")

# ---- group: Volume
box = Box({Plane=PlaneXY(0, 0, 0), X=Domain(-27.04713456, 42.93584143), Y=Domain(-23.45763848, 41.88845835), Z=Domain(0.01075653027, 62.99229233)})
center = Center(Geometry=box)  # -> Center, Dimension
scale = Scale(Geometry=box, Center=center.Center, Factor=Slider(1.5, range=0..10))  # -> Geometry, Transform

# ----
file = FileReader(FilePath=path)
file_2 = FileReader(FilePath=path_2)
# Normalize
# Normalize
# Normalize
# Normalize
# Normalize
# Normalize
number_slider = Slider(5, range=0..10)
number_slider_2 = Slider(5, range=0..10)
deb = BytesDecoder(Bytes=file)
deb_2 = BytesDecoder(Bytes=file_2)
nickname = DeserializeVoxels(VStr=deb)  # -> Voxels, VoxelSize, States
nickname_2 = DeserializeVoxels(VStr=deb_2)  # -> Voxels, VoxelSize, States
vec = VectorXYZ(XComponent=number_slider, YComponent=number_slider, ZComponent=number_slider)  # -> Vector, Length
vec_2 = VectorXYZ(XComponent=number_slider_2, YComponent=number_slider_2, ZComponent=number_slider_2)  # -> Vector, Length
filter = VoxelFilter(VoxelPos=nickname.Voxels, VoxelSize=nickname.VoxelSize, States=nickname.States, TargetState=1)  # -> VoxelPos, VoxelSize
filter_2 = VoxelFilter(VoxelPos=nickname_2.Voxels, VoxelSize=nickname_2.VoxelSize, States=nickname_2.States, TargetState=1)  # -> VoxelPos, VoxelSize
lng = ListLength(List=filter.VoxelPos)
lng_2 = ListLength(List=filter_2.VoxelPos)
dup = DuplicateData(Data=vec.Vector, Number=lng, Order=True)
dup_2 = DuplicateData(Data=vec_2.Vector, Number=lng_2, Order=True)
voxmesh = VoxelMesher(VoxelPos=filter.VoxelPos, VoxelSize=dup, Algorithm=Slider(1, range=0..10))
voxmesh_2 = VoxelMesher(VoxelPos=filter_2.VoxelPos, VoxelSize=dup_2, Algorithm=Slider(1, range=0..10))
panel = Panel("grid_22x20x20")
preview = CustomPreview(Geometry=voxmesh_2, Material=ColourSwatch(SwatchColor=RGB(115, 147, 255)))
preview_2 = CustomPreview(Geometry=voxmesh, Material=ColourSwatch(SwatchColor=RGB(255, 164, 115)))

# ----
# Evaluate with new geometry
subd = SubD(<subd referenced from the Rhino model>)
number_slider_3 = Slider(5, range=0..10)
meshsubd = MeshFromSubD(SubD=subd, Density=2)
mesh = Mesh(meshsubd)
vec_3 = VectorXYZ(XComponent=number_slider_3, YComponent=number_slider_3, ZComponent=number_slider_3)  # -> Vector, Length
box_2 = Box(scale.Geometry)
path_3 = FilePath("F:\lab\3d-autoencoder\data\test\")
concat = Concatenate(FragmentA=path_3, FragmentB="inference_", FragmentC=Slider(0, range=0..100))

voxelsh = VoxelizeMeshSH(Mesh=mesh, VoxelSize=vec_3.Vector, Bounds=box_2)  # -> Voxels, VoxelSize, States, VoxelGrid
python = GhPythonScript(items=flatten(voxelsh.States))  # -> a; inputs items: list
# ---------- python: Python ----------
import rhinoscriptsyntax as rs

empty_count = 0
occupied_count = 0

for i in items:
    if i == 0:
        empty_count += 1
    elif i == 1:
        occupied_count +=1


a = occupied_count / len(items)
# ---------- end python ----------
serializevoxelgrid = SerializeVoxelGrid(VoxelGrid=voxelsh.VoxelGrid, ExtractParts=Slider(0, range=0..10))  # -> Serialized1D, Serialized3D

filter_3 = VoxelFilter(VoxelPos=voxelsh.Voxels, VoxelSize=voxelsh.VoxelSize, States=voxelsh.States, TargetState=1)  # -> VoxelPos, VoxelSize
voxmesh_3 = VoxelMesher(VoxelPos=filter_3.VoxelPos, VoxelSize=filter_3.VoxelSize, Algorithm=1)
file_3 = FileWriter(Bytes=serializevoxelgrid.Serialized1D, FilePath=concat, Write=write)

panel_2 = Panel(python)
